# Grasshopper definition example.gh (Grasshopper 1.0.7)
# plug-ins: baues-toolbox Info

brep = Brep([<brep referenced from the Rhino model> x3])
srf = Surface([<surface referenced from the Rhino model> x2])
create = Create(Geometries=brep, Windows=srf, Tolerance=Slider(0.1, range=0..0.1))
zone = Zone(Baues=create, Program="resindetial", SpaceType="bedRoom", Envelope="concrete")  # -> Baues, BauesJson
